# Dynamo graph auto_1-Plumbing Fixture_Schedule_to_Excel.dyn "2_Schedule_to_Excel" (Dynamo 2.12.0.5650)
# packages: bimorphNodes 4.0.9

file_path = Filename("C:\Users\ttabassum\Documents\Area Automation\TorreyView\Dynamo\test.xlsx")  # graph input
string = StringInput("Sheet 1")  # graph input
code_block = CodeBlock { 0; }
views = Views("Area Schedule (PFC)")  # graph input
boolean = BoolSelector(true)
boolean_2 = BoolSelector(true)
getData = Revit.Schedule.GetData(scheduleView=views, removeHeading=boolean, refresh=boolean_2)
exportToExcel = Data.ExportToExcel(filePath=file_path, sheetName=string, startRow=code_block, startColumn=code_block, data=getData)
