# Dynamo graph auto_2-Plubing Fixture_ExceltoPFC.dyn "3_ExceltoPFCFamily" (Dynamo 2.12.1.8246)
# packages: archi-lab.net 2022.212.2922

# group: import excel data
file_path = Filename("..\FixtureCount_IBC2018.xlsb.xlsm")
file_from_path = FileObject(path=file_path)
string = StringInput("Fixture Sched_IBC 2018")
boolean = BoolSelector(false)
importExcel = Data.ImportExcel(file=file_from_path, sheetName=string, readAsStrings=boolean)

# group: arrange list
firstItem = List.FirstItem(list=importExcel)
restOfItems = List.RestOfItems(list=importExcel)
transpose = List.Transpose(lists=restOfItems)

# group: family type:pfc
family_types = FamilyTypes("Plumbing Fixture Count:Plumbing Fixture Count")
all_elements_of_family_type = ElementsOfFamilyType(Family_Type=family_types)
code_block = CodeBlock { "Plumbing_Occupancy_Type"; }
getParameterValueByName = Element.GetParameterValueByName(parameterName=code_block)  # unwired: element
sortByFunction = List.SortByFunction(list=all_elements_of_family_type, sortFunction=getParameterValueByName)

clear_list = Custom[Clear List](input=transpose)  # package archi-lab.net; This node will remove all Null and Empty Lists from any list.

# group: LEVEL
code_block_2 = CodeBlock { "Level"; }
code_block_3 = CodeBlock { 0; }
getItemAtIndex = List.GetItemAtIndex(list=clear_list, index=code_block_3)
string_from_object = FromObject(object=getItemAtIndex)
setParameterByName = Element.SetParameterByName(element=sortByFunction, parameterName=code_block_2, value=string_from_object)

code_block_4 = CodeBlock { "Plumbing Occupancy Type"; }

# group: PLUMBING OCCUPANCY TYPE
code_block_5 = CodeBlock { 1; }
getItemAtIndex_2 = List.GetItemAtIndex(list=clear_list, index=code_block_5)
setParameterByName_2 = Element.SetParameterByName(element=sortByFunction, parameterName=code_block_4, value=getItemAtIndex_2)

# group: FEMALE WC
code_block_6 = CodeBlock { "WC-F"; }
code_block_7 = CodeBlock { 4; }
getItemAtIndex_3 = List.GetItemAtIndex(list=transpose, index=code_block_7)
setParameterByName_3 = Element.SetParameterByName(element=sortByFunction, parameterName=code_block_6, value=getItemAtIndex_3)

# group: MALE LAV
code_block_8 = CodeBlock { "LAV-M"; }
code_block_9 = CodeBlock { 5; }
getItemAtIndex_4 = List.GetItemAtIndex(list=clear_list, index=code_block_9)
setParameterByName_4 = Element.SetParameterByName(element=sortByFunction, parameterName=code_block_8, value=getItemAtIndex_4)

# group: FEMALE LAV
code_block_10 = CodeBlock { "LAV-F"; }
code_block_11 = CodeBlock { 6; }
getItemAtIndex_5 = List.GetItemAtIndex(list=clear_list, index=code_block_11)
setParameterByName_5 = Element.SetParameterByName(element=sortByFunction, parameterName=code_block_10, value=getItemAtIndex_5)

# group: DRINKING FOUNTAINS
code_block_12 = CodeBlock { "Drinking Fountains"; }
code_block_13 = CodeBlock { 7; }
getItemAtIndex_6 = List.GetItemAtIndex(list=clear_list, index=code_block_13)
setParameterByName_6 = Element.SetParameterByName(element=sortByFunction, parameterName=code_block_12, value=getItemAtIndex_6)

# group: MALE WC
code_block_14 = CodeBlock { "WC-M"; }
code_block_15 = CodeBlock { 3; }
getItemAtIndex_7 = List.GetItemAtIndex(list=clear_list, index=code_block_15)
setParameterByName_7 = Element.SetParameterByName(element=sortByFunction, parameterName=code_block_14, value=getItemAtIndex_7)

code_block_16 = CodeBlock { "Plumbing Occupant Load"; }

# group: PLUMBING OCCUPANT LOAD
code_block_17 = CodeBlock { 2; }
getItemAtIndex_8 = List.GetItemAtIndex(list=clear_list, index=code_block_17)
string_from_object_2 = FromObject(object=getItemAtIndex_8)
setParameterByName_8 = Element.SetParameterByName(element=sortByFunction, parameterName=code_block_16, value=string_from_object_2)

code_block_18 = CodeBlock {  }
